# Grasshopper definition Debugging and testing.gh (Grasshopper 1.0.7)
# Copyright: 2021

# Template Headers
brep = Brep(<brep referenced from the Rhino model>)
c_script = CSharpScript(x=brep)  # -> out, A; inputs x: Brep
# ---------- c_script: C# usings ----------
using System.Linq;
# ---------- c_script: C# ----------
    A = x.Vertices.Select(a => a.Location).Select(b => b.Y).Min();
# ---------- c_script: C# additional code ----------
  public void GetGridPlane(Brep brep)
  {
    var Brepvertices = brep.Vertices;
    var BrepPts = Brepvertices.Select(a => a.Location).ToList();
    var  LowestX = Brepvertices.Select(a => a.Location).Select(b => b.X).Min();
    var LowestY = Brepvertices.Select(a => a.Location).Select(b => b.Y).Min();
    var LowestZ = Brepvertices.Select(a => a.Location).Select(b => b.Z).Min();
    var MaxX = Brepvertices.Select(a => a.Location).Select(b => b.X).Max();
    var MaxY = Brepvertices.Select(a => a.Location).Select(b => b.Y).Max();

    Point3d Pa = new Point3d();
    Point3d Pb = new Point3d();
    Point3d Pc = new Point3d();

    foreach ( var pt in BrepPts)
    {
      if (pt.X == LowestX && pt.Y == LowestY && pt.Z == LowestZ)
      {
        Pa = pt;
      }
      if (pt.X == MaxX && pt.Y == LowestY && pt.Z == LowestZ)
      {
        Pb = pt;
      }
      if (pt.X == LowestX && pt.Y == MaxY && pt.Z == LowestZ)
      {
        Pc = pt;
      }
    }

    Vector3d u = Pb - Pa;
    Vector3d v = Pc - Pa;
    Point3d origin = Pa;

    Plane plane = new Plane(origin, u, v);
  }
# ---------- end c_script ----------
