# Grasshopper definition forma-api.gh (Grasshopper 1.0.7)
# Copyright: 2024
# plug-ins: Formicae, Swiftlet

panel = Panel("https://app.autodeskforma.eu/designmode/pro_74nzjy4r4h/51001399-12b2-4ad5-87a8-6e7772e3fdad")
brep = Brep(<brep referenced from the Rhino model>)
create_simulation_box = CreateSimulationBox(Box=brep)  # -> SimulationPoints, ResultMeshGrid, SimulationBox
mesh = Mesh(<mesh referenced from the Rhino model>)
brep_2 = Brep([<brep referenced from the Rhino model> x4])
auth = Auth(Trigger=Button())
gh_createwindsimulationmodel = GH_CreateWindSimulationModel(TerrainMesh=mesh, BuildingsBreps=brep_2, SimulationBox=create_simulation_box.SimulationBox)
clean = CleanTree(RemoveNulls=True, RemoveInvalid=True, RemoveEmpty=False, Tree=auth)
geometry = Geometry([<brep referenced from the Rhino model> x4, <mesh referenced from the Rhino model>])
data = Data(flatten(clean))
unit_z = UnitZ(Factor=1)
python = GhPythonScript()  # -> out, key, value
# ---------- python: Python ----------
import rhinoscriptsyntax as rs

ghenv.Component.Message = "x-ads-region"


key = "x-ads-region"
value = "EMEA"
# ---------- end python ----------
mesh_2 = Mesh(geometry)
python_2 = GhPythonScript(url=panel)  # -> out, key, value
# ---------- python_2: Python ----------
import rhinoscriptsyntax as rs

ghenv.Component.Message = "authcontext"
urlParts = url.split("/")

key = "authcontext"
value = urlParts[-2]
# ---------- end python_2 ----------
negative = Negative(Value=unit_z)
bearer = BearerTokenAuth(Token=data)
mesh_ray = MeshRay(Mesh=mesh_2, Point=create_simulation_box.SimulationPoints, Direction=negative)  # -> Point, Hit
python_3 = GhPythonScript()  # -> out, endPoint
# ---------- python_3: Python ----------
__author__ = "ARZE"
__version__ = "2024.02.14"

import rhinoscriptsyntax as rs
ghenv.Component.Message = "Wind params end point"
endPoint  = "https://developer.api.autodesk.com/forma/wind-prediction/v1alpha/parameters"
# ---------- end python_3 ----------
cqp = CreateQueryParam(Key=python_2.key, Value=python_2.value)
ch = CreateHttpHeader(Key=python.key, Value=python.value)
gh_createheightmaps = GH_CreateHeightMaps(WindSimModel=gh_createwindsimulationmodel)  # -> HeightsMapWithoutBuildings, HeightsMapWithBuildings
merge = Merge(Data1=bearer, Data2=ch)
get = GETRequest(URL=python_3.endPoint, Params=cqp, Headers=merge)  # -> Status, Content, Response
deconstruct = Deconstruct(Point=mesh_ray.Point)  # -> XComponent, YComponent, ZComponent
dam = DataDam(DataA=gh_createheightmaps.HeightsMapWithoutBuildings, BufferDelay=10000000, BufferMode=0)

# ---- group: Model With Bldgs
ghpython_script = GhPythonScript(x=gh_createwindsimulationmodel)  # -> out, a; disabled
# ---------- ghpython_script: Python ----------
__author__ = "mm1039"
__version__ = "2024.02.14"

import rhinoscriptsyntax as rs

a = x.ModelWithBuildings
# ---------- end ghpython_script ----------

# ---- group: ModelWithoutBuilding
ghpython_script_2 = GhPythonScript(x=gh_createwindsimulationmodel)  # -> out, a; disabled
# ---------- ghpython_script_2: Python ----------
__author__ = "mm1039"
__version__ = "2024.02.14"

import rhinoscriptsyntax as rs

a = x.ModelwithoutBuildings
# ---------- end ghpython_script_2 ----------

# ---- group: Result mesh draped
ghpython_script_3 = GhPythonScript(x=gh_createwindsimulationmodel)  # -> out, a; disabled
# ---------- ghpython_script_3: Python ----------
__author__ = "mm1039"
__version__ = "2024.02.14"

import rhinoscriptsyntax as rs

a = x.GetResultMeshDraped()
# ---------- end ghpython_script_3 ----------

# ----
python_4 = GhPythonScript()  # -> out, endPoint
# ---------- python_4: Python ----------
__author__ = "ARZE"
__version__ = "2024.02.14"

import rhinoscriptsyntax as rs
ghenv.Component.Message = "Predict end point"
endPoint  = "https://developer.api.autodesk.com/forma/wind-prediction/v1alpha/predict"
# ---------- end python_4 ----------

# ---- group: Min and max
bounds = Bounds(Numbers=deconstruct.ZComponent)
deconstruct_domain = DeconstructDomain(Domain=bounds)  # -> Start, End

# ----
min = Data(deconstruct_domain.Start)
max = Data(deconstruct_domain.End)
subtraction = Subtraction(A=gh_createheightmaps.HeightsMapWithoutBuildings, B=min)
subtraction_2 = Subtraction(A=max, B=min)
subtraction_3 = Subtraction(A=deconstruct.ZComponent, B=min)
division = Division(A=subtraction, B=subtraction_2)
division_2 = Division(A=subtraction_3, B=subtraction_2)
multiplication = Multiplication(A=division, B=255)
multiplication_2 = Multiplication(A=division_2, B=255)
round = Round(Number=multiplication)  # -> Nearest, Floor, Ceiling
round_2 = Round(Number=multiplication_2)  # -> Nearest, Floor, Ceiling
python_5 = GhPythonScript(
    buildingAndTerrainHeightArray=round_2.Nearest,
    terrainHeightArray=round.Nearest,
    minHeight=deconstruct_domain.Start,
    maxHeight=deconstruct_domain.End)  # -> out, a; inputs buildingAndTerrainHeightArray: list of Int32, terrainHeightArray: list of Int32
# ---------- python_5: Python ----------
__author__ = "ARZE"
__version__ = "2024.02.14"

import rhinoscriptsyntax as rs
import json

heightMaps  = {
        "terrainHeightArray": terrainHeightArray,
        "minHeight": minHeight,
        "maxHeight": maxHeight,
        "buildingAndTerrainHeightArray":buildingAndTerrainHeightArray
    }
    
    
a = json.dumps(heightMaps)
# ---------- end python_5 ----------
dam_2 = DataDam(DataA=python_5.a, BufferDelay=10000000, BufferMode=0)
python_6 = GhPythonScript(wind_param=get.Content, a=dam_2)  # -> out, body_dump, b
# ---------- python_6: Python ----------
__author__ = "ARZE"
__version__ = "2024.02.13"

import rhinoscriptsyntax as rs
import json

body = dict()
type = "comfort"
#"roughness": 0.6065,
comfortScale = "lawson_lddc"


wind_param_parts = json.loads(wind_param)
roughness = wind_param_parts["roughness"]

    
    
heightMaps = json.loads(a)
    
del wind_param_parts["roughness"]


body["heightMaps"] = heightMaps
body["windRose"] = wind_param_parts
body["type"] = type
body["roughness"] = roughness
body["comfortScale"] = comfortScale

body_dump = json.dumps(body)

b = json.dumps(body)


# Convert the body dictionary to a JSON formatted string
body_dump = json.dumps(body, indent=4) # indent=4 for pretty printing

# Specify the path to the output file
output_file_path = r"C:\Users\Arze\Downloads\output.json"

# Writing the JSON data to the output file
with open(output_file_path, 'w') as file:
    file.write(body_dump)
# ---------- end python_6 ----------
ctb = CreateTextBody(
    Content=python_6.body_dump,
    IsHtmlChecked=False,
    IsJavascriptChecked=False,
    IsJsonChecked=True,
    IsTextChecked=False,
    IsXmlChecked=False)
post = POSTRequest(URL=python_4.endPoint, Body=ctb, Params=cqp, Headers=merge)  # -> Status, Content, Response
panel_2 = Panel(post.Content)
